# Grasshopper definition Assn01_HopsGlazing.gh (Grasshopper 1.0.7)

number_slider = Slider(0.4, range=0..1)
number_slider_2 = Slider(0.03, range=0.01..1)
glazing_unit_type = GetInteger(Slider(2, range=1..3), AtLeast=1, AtMost=1, Maximum=2147483647, Minimum=-2147483648, Prompt="1=Single, 2=DGU, 3=TGU")
unit_height = GetNumber(Slider(12, range=1..50), AtLeast=1, AtMost=1, Maximum=50, Minimum=1)
glass_thickness = GetNumber(Slider(0.25, range=0.125..0.5), AtLeast=1, AtMost=1, Maximum=0.5, Minimum=0.125, Prompt="0.125 to 0.5")
air_gap = GetNumber(Slider(0.5, range=0.25..1), AtLeast=1, AtMost=1, Maximum=1, Minimum=0.25)
subtraction = Subtraction(A=glazing_unit_type, B="1")
pt = ConstructPoint(XCoordinate=0, YCoordinate=0, ZCoordinate=0)
pt_2 = ConstructPoint(XCoordinate=glass_thickness, YCoordinate=unit_height, ZCoordinate=0)
X = UnitX(Factor=glass_thickness)
X_2 = UnitX(Factor=glass_thickness)
move = Move(Geometry=pt, Motion=X)  # -> Geometry, Transform
vec = VectorXYZ(XComponent=glass_thickness, YComponent=unit_height, ZComponent=0)  # -> Vector, Length
vec_2 = VectorXYZ(XComponent=glass_thickness, YComponent=unit_height, ZComponent=0)  # -> Vector, Length
X_3 = UnitX(Factor=air_gap)
X_4 = UnitX(Factor=air_gap)
rec_2pt = Rectangle2Pt(Plane=PlaneXY(0, 0, 0), PointA=pt, PointB=pt_2, Radius=0)  # -> Rectangle, Length
move_2 = Move(Geometry=move.Geometry, Motion=X_3)  # -> Geometry, Transform
move_3 = Move(Geometry=move_2.Geometry, Motion=X_2)  # -> Geometry, Transform
move_4 = Move(Geometry=move_2.Geometry, Motion=vec.Vector)  # -> Geometry, Transform
move_5 = Move(Geometry=move_3.Geometry, Motion=X_4)  # -> Geometry, Transform
move_6 = Move(Geometry=move_5.Geometry, Motion=vec_2.Vector)  # -> Geometry, Transform
fillet = Fillet(Curve=rec_2pt.Rectangle, Radius=number_slider_2)
rec_2pt_2 = Rectangle2Pt(Plane=PlaneXY(0, 0, 0), PointA=move_2.Geometry, PointB=move_4.Geometry, Radius=0)  # -> Rectangle, Length
rec_2pt_3 = Rectangle2Pt(Plane=PlaneXY(0, 0, 0), PointA=move_5.Geometry, PointB=move_6.Geometry, Radius=0)  # -> Rectangle, Length
explode = Explode(Curve=fillet, Recursive=True)  # -> Segments, Vertices
pline = PolyLine(Vertices=explode.Vertices, Closed=False)
fillet_2 = Fillet(Curve=rec_2pt_3.Rectangle, Radius=number_slider_2)
fillet_3 = Fillet(Curve=rec_2pt_2.Rectangle, Radius=number_slider_2)
explode_2 = Explode(Curve=fillet_2, Recursive=True)  # -> Segments, Vertices
explode_3 = Explode(Curve=fillet_3, Recursive=True)  # -> Segments, Vertices
pline_2 = PolyLine(Vertices=explode_2.Vertices, Closed=False)
pline_3 = PolyLine(Vertices=explode_3.Vertices, Closed=False)
vec_3 = VectorXYZ(XComponent=air_gap, YComponent=number_slider, ZComponent=0)  # -> Vector, Length
move_7 = Move(Geometry=move.Geometry, Motion=vec_3.Vector)  # -> Geometry, Transform
move_8 = Move(Geometry=move_3.Geometry, Motion=vec_3.Vector)  # -> Geometry, Transform
rec_2pt_4 = Rectangle2Pt(Plane=PlaneXY(0, 0, 0), PointA=move.Geometry, PointB=move_7.Geometry, Radius=0)  # -> Rectangle, Length
rec_2pt_5 = Rectangle2Pt(Plane=PlaneXY(0, 0, 0), PointA=move_3.Geometry, PointB=move_8.Geometry, Radius=0)  # -> Rectangle, Length
subtraction_2 = Subtraction(A=unit_height, B=number_slider)
subtraction_3 = Subtraction(A=unit_height, B=number_slider)
offset = OffsetCurve(Curve=rec_2pt_4.Rectangle, Distance=Slider(-0.04, range=-0.1..0.1), Corners=1)
Y = UnitY(Factor=subtraction_2)
offset_2 = OffsetCurve(Curve=rec_2pt_5.Rectangle, Distance=Slider(-0.04, range=-0.1..0.1), Corners=1)
Y_2 = UnitY(Factor=subtraction_3)
move_9 = Move(Geometry=[rec_2pt_4.Rectangle, offset], Motion=Y)  # -> Geometry, Transform
move_10 = Move(Geometry=[rec_2pt_5.Rectangle, offset_2], Motion=Y_2)  # -> Geometry, Transform
filter = StreamFilter(
    Gate=subtraction,
    Stream0=pline,
    Stream1=[pline, pline_3, move_9.Geometry, rec_2pt_4.Rectangle, offset],
    Stream2=[pline, pline_3, pline_2, move_10.Geometry, rec_2pt_5.Rectangle, offset_2, move_9.Geometry, rec_2pt_4.Rectangle, offset])  # -> flatten(Stream)
crv = Curve(filter)
context_bake = ContextBake(Geometry=crv)
